# Grasshopper definition abb_linear_axis.ghx (Grasshopper 0.9.76)
# plug-ins: Python Interpreter

py = PythonScript()  # -> path
# ---------- py: Python ----------
import os

filepath = ghenv.Component.OnPingDocument().FilePath
path = os.path.dirname(filepath)
# ---------- end py ----------
reload = Button()

# ---- group: ROS client
# processes to launch: roslaunch abb_linear_axis_brick_moveit_config demo.launch
# roslaunch rosbridge_server rosbridge_websocket.launch
disconnect = Button()
connect = Button()
restart = Button()
ros = PythonScript(restart=restart)  # -> out, ros_client
# ---------- ros: Python ----------
import sys
import time
import logging
import scriptcontext as sc

from compas_fab.backends import RosClient

from System import TimeSpan
from System.Threading import ManualResetEventSlim

LOGGER = logging.getLogger('roslibpy')

key = 'rosclient_%s' % str(ghenv.Component.InstanceGuid)
previous_client = sc.sticky.get(key, None)
if previous_client:
    previous_client.terminate()

ros_client = RosClient('127.0.0.1', 9090)
sc.sticky[key] = ros_client

waitLock = ManualResetEventSlim(False)

ros_client.on_ready(lambda: waitLock.Set())

if not waitLock.Wait(TimeSpan.FromSeconds(5)):
    raise Exception('Unable to connect to ROS')

LOGGER.info('ROS connection opened')
# ---------- end ros ----------
connect_2 = PythonScript(ros_client=ros.ros_client, connect=connect, disconnect=disconnect)  # -> out, ros_client
# ---------- connect_2: Python ----------
import logging
from System import TimeSpan
from System.Threading import ManualResetEventSlim

LOGGER = logging.getLogger('roslibpy')

if connect:
    if not ros_client.is_connected:
        LOGGER.debug('Connecting...')
        waitLock = ManualResetEventSlim(False)
        ros_client.on_ready(lambda: waitLock.Set())
        ros_client.connect()

        if not waitLock.Wait(TimeSpan.FromSeconds(5)):
            raise Exception('Unable to connect to ROS')
        LOGGER.debug('Reconnected')

if disconnect:
    if ros_client.is_connected:
        ros_client.terminate()
        LOGGER.debug('Terminated')
# ---------- end connect_2 ----------

# ----
# Robot
py_2 = PythonScript(path=py)  # -> robot_description
# ---------- py_2: Python ----------
import os
robot_description = os.path.join(path, "robot_description")
# ---------- end py_2 ----------
list = ValueList({"abb_irb4600_40_255", "staubli_tx60l"}, selected="abb_irb4600_40_255")
list_2 = ValueList({"abb_end_effectors", "abb_irb4600_40_255", "staubli_tx60l"}, selected="abb_end_effectors")
list_3 = ValueList({"rfl", "abb_irb4600_40_255", "staubli_tx60l", "abb_linear_axis"}, selected="abb_linear_axis")
py_3 = PythonScript(path=py_2, packages=[list, list_3, list_2])  # -> loaders; inputs packages: list
# ---------- py_3: Python ----------
from compas.robots import LocalPackageMeshLoader

loaders = []
for package in packages:
    loaders.append(LocalPackageMeshLoader(path, package))
# ---------- end py_3 ----------
py_4 = PythonScript(
    path=py_2,
    package=list_3,
    urdf_name="abb_linear_axis_brick_suction_tool.urdf",
    srdf_name="abb_linear_axis_suction_tool.srdf")  # -> package_path, urdf_filename, srdf_filename
# ---------- py_4: Python ----------
import os

package_path = os.path.join(path, package)

urdf_filename = os.path.join(package_path, "urdf", urdf_name)
srdf_filename = os.path.join(package_path, srdf_name)

assert os.path.isfile(urdf_filename)
assert os.path.isfile(srdf_filename)
# ---------- end py_4 ----------
load = Button()
units = ValueList({"m": 1, "cm": 100, "mm": 1000}, selected="m")
create = PythonScript(loaders=py_3, urdf_filename=py_4.urdf_filename, srdf_filename=py_4.srdf_filename, scale_factor=units, load=load)  # -> robot; inputs loaders: list
# ---------- create: Python ----------
import os
from scriptcontext import sticky as st

import compas

from compas.robots import RobotModel
from compas.robots import LocalPackageMeshLoader

from compas_fab.robots import Robot
from compas_fab.robots import RobotSemantics

from compas_fab.ghpython import RobotArtist

compas.PRECISION = '12f'

# store robot in component
guid = str(ghenv.Component.InstanceGuid)
robot_key = "robot_" + guid

if robot_key not in st:
    st[robot_key] = None

if load:
    model = RobotModel.from_urdf_file(urdf_filename)
    model.load_geometry(*loaders)
    artist = RobotArtist(model)
    semantics = RobotSemantics.from_srdf_file(srdf_filename, model)
    robot = Robot(model, artist, semantics, client=None)
    
    st[robot_key] = robot

robot = st[robot_key]

if robot:
    robot.scale(scale_factor)
# ---------- end create ----------
robot = Data(create)
set = PythonScript(robot=robot, client=connect_2.ros_client)
# ---------- set: Python ----------
if robot and client:
    robot.client = client
# ---------- end set ----------

# ----
# Create attached collision object
number_slider = Slider(0.053, range=0..0.1)
brick = PythonScript(w=Slider(0.115, range=0..1), d=Slider(0.24, range=0..1), h=number_slider)  # -> brick
# ---------- brick: Python ----------
import Rhino.Geometry as rg


brick = rg.Box(rg.Plane.WorldXY, rg.Interval(-w/2,w/2), rg.Interval(-d/2,d/2), rg.Interval(-h,0))
# ---------- end brick ----------
mesh = Mesh(brick)
mesh_2 = PythonScript(mesh=mesh, scale_factor=units, path=py)  # -> compas_mesh
# ---------- mesh_2: Python ----------
import os
import compas
from compas.datastructures import Mesh
from compas.datastructures import mesh_quads_to_triangles
from compas_rhino.helpers import mesh_from_guid

import Rhino.Geometry as rg

S = rg.Transform.Scale(rg.Plane.WorldXY, 1./scale_factor, 1./scale_factor, 1./scale_factor)
mesh.Transform(S)

compas_mesh = mesh_from_guid(Mesh, mesh)
mesh_quads_to_triangles(compas_mesh)

compas_mesh.to_obj(os.path.join(path,'brick.obj'))
# ---------- end mesh_2 ----------
groups = ValueList({"axis_abb", "abb"}, selected="axis_abb")
attached_co = PythonScript(robot=robot, group=groups, compas_mesh=mesh_2, id_name="brick")  # -> attached_collision_object
# ---------- attached_co: Python ----------
base_link_name = robot.get_base_link_name(group)
ee_name = robot.get_end_effector_link_name(group)
print base_link_name
print ee_name
last_link_with_geometry = None
for link in reversed(list(robot.model.iter_link_chain(base_link_name, ee_name))):
    if len(link.collision) or len(link.visual):
        last_link_with_geometry = link.name
        break
print(last_link_with_geometry)
touch_links = [last_link_with_geometry]

aco = robot.create_collision_mesh_attached_to_end_effector(id_name, compas_mesh, group)
#aco = robot.build_attached_collision_mesh(id_name,  compas_mesh, group=None, touch_links=touch_links, scale=False)
# ---------- end attached_co ----------

panel = Panel("Define an obstacle")
brep = Brep(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)
mesh_3 = Mesh(brep)
preview = CustomPreview(Geometry=brep, Shader=ColourSwatch(SwatchColor=RGB(255, 255, 255)))
mesh_4 = PythonScript(mesh=mesh_3, scale_factor=units)  # -> compas_mesh
# ---------- mesh_4: Python ----------
import compas
from compas.datastructures import Mesh
from compas.datastructures import mesh_quads_to_triangles
from compas_rhino.helpers import mesh_from_guid

import Rhino.Geometry as rg

S = rg.Transform.Scale(rg.Plane.WorldXY, 1./scale_factor, 1./scale_factor, 1./scale_factor)
mesh.Transform(S)

compas_mesh = mesh_from_guid(Mesh, mesh)
mesh_quads_to_triangles(compas_mesh)
# ---------- end mesh_4 ----------
remove = Button()
add = Button()
collision = PythonScript(robot=robot, compas_mesh=mesh_4, id_name="floor", add=add, remove=remove)  # -> out
# ---------- collision: Python ----------
if robot and robot.client:
    if add:
        robot.add_collision_mesh_to_planning_scene(id_name, compas_mesh)
    if remove:
        robot.remove_collision_mesh_from_planning_scene(id_name)
else:
    print("Robot is not connected")
# ---------- end collision ----------
panel_2 = Panel(collision)

# ----
# Scene geometry
mesh_5 = PythonScript(package_path=py_4.package_path)  # -> compas_mesh, M
# ---------- mesh_5: Python ----------
import os
from compas.datastructures import Mesh
from compas_ghpython import mesh_draw

compas_mesh = Mesh.from_stl(os.path.join(package_path, 'meshes', 'collision', 'platform.stl'))

M = mesh_draw(compas_mesh)
# ---------- end mesh_5 ----------
preview_2 = CustomPreview(Geometry=mesh_5.M, Shader=ColourSwatch(SwatchColor=RGB(255, 255, 255)))
remove_2 = Button()
add_2 = Button()
# Pass collision object to planning scene
collision_2 = PythonScript(robot=robot, compas_mesh=mesh_5.compas_mesh, id_name="platform", add=add_2, remove=remove_2)  # -> out; same code as collision
panel_3 = Panel(collision_2)
remove_3 = Button()
collision_3 = PythonScript(robot=robot, id_name="brick_wall", remove=remove_3)  # -> out
# ---------- collision_3: Python ----------
if robot and robot.client:
    if remove:
        robot.remove_collision_mesh_from_planning_scene(id_name)
else:
    print("Robot is not connected")
# ---------- end collision_3 ----------
panel_4 = Panel(collision_3)

# ----
# TODO: needs to be replaced
number_slider_2 = Slider(10, range=0..100)
panel_5 = Panel("Generate brick wall")
srf = Surface(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)
python = PythonScript(srf=srf, brick=brick, layers=Slider(5, range=0..100), num_per_layer=number_slider_2)  # -> P, frames, layers, bricks; inputs srf: Brep, brick: Box, layers: Int32
# ---------- python: Python ----------
import Rhino.Geometry as rg
from compas.geometry import Frame

brick_w = brick.X[1] - brick.X[0] # w
brick_d = brick.Y[1] - brick.Y[0] # d
brick_h = brick.Z[1] - brick.Z[0] # h

bbox = srf.GetBoundingBox(rg.Plane.WorldXY)
minZ = bbox.Min.Z
tol = 0.001

C = []

for i in range(1, layers + 1):
    plane = rg.Plane(rg.Plane.WorldXY)
    plane.Origin = rg.Point3d(0, 0, minZ + i * brick_h)
    rc, crvs, pts = rg.Intersect.Intersection.BrepPlane(srf, plane, tol)
    C.append(crvs[0])


bricks = []
layers = []

P = []

for i, crv in enumerate(C):
    params = crv.DivideByCount(num_per_layer * 2, False)
    if i%2 == 0:
        params = [t for k, t in enumerate(params) if k%2 == 0]
    else:
        params = [t for k, t in enumerate(params) if k%2 == 1]
    frames = []
    for t in params:
        pt = crv.PointAt(t)
        tangent = crv.TangentAt(t)
        yaxis = rg.Vector3d.CrossProduct(rg.Vector3d.ZAxis, tangent)
        frame = Frame(pt, yaxis, tangent)
        frames.append(frame)
        P.append(pt)
        R = rg.Transform.Rotation(rg.Vector3d.XAxis, yaxis, rg.Point3d(0,0,0))
        T = rg.Transform.Translation(pt - rg.Point3d(0,0,brick_h))
        bbrick = brick.ToBrep()
        bbrick.Transform(T*R)
        bricks.append(bbrick)
    layers.append(frames)


frames = []

for alist in layers:
    for frame in alist:
        frames.append(frame)
# ---------- end python ----------
path = FilePath("C:\Users\rustr\workspace\robotic_assembly_workshop\examples\exXX_buildable_bricks_within_reach.py")
panel_6 = Panel(path)
write = Button()
python_2 = PythonScript(layers=python.layers, path=path, name="frames.json", write=write)  # inputs layers: list
# ---------- python_2: Python ----------
import os
import json

path = os.path.dirname(path)
filename = os.path.join(path, name)

layers = [[frame.data for frame in frames] for frames in layers]

def write_json(filename, data):
    with open(filename, 'w+') as f:
        json.dump(data, f)

if write:
    data = layers
    write_json(filename, data)
# ---------- end python_2 ----------
reset = Button()
step = Button()
counter = CountThroughList(L=python.frames, step=step, reset=reset)  # -> i, item; inputs L: list
# ---------- counter: Python ----------
from scriptcontext import sticky as st

# store data in component
guid = str(ghenv.Component.InstanceGuid)
counter_key = "counter_" + guid

if counter_key not in st or reset:
    st[counter_key] = 0

if step:
    st[counter_key] += 1
    
if len(L):
    st[counter_key] = min(st[counter_key], len(L) - 1)
    
    item = L[st[counter_key]]

i = st[counter_key]
# ---------- end counter ----------
py_5 = PythonScript(frame=counter.item)  # -> plane
# ---------- py_5: Python ----------
from compas_ghpython import xdraw_frame


plane = xdraw_frame(frame)
# ---------- end py_5 ----------
panel_7 = Panel(py_5)
index = Panel(counter.i)
draw = PlaneDraw(plane=py_5, scale=0.001)  # -> G, C
# ---------- draw: Python ----------
from System.Drawing import Color
from compas.geometry import Frame, Point, Vector

from compas_ghpython.utilities import xdraw_frame
from compas_ghpython.utilities import xdraw_pipes

if not scale:
    scale = 1

pipe_size = 100 * scale
pipe_radius = 1 * scale

red = Color.FromArgb(255, 0, 0)
green = Color.FromArgb(0, 255, 0)
blue = Color.FromArgb(0, 0, 255)

frame_colors = [red, green, blue]

# TODO: move to frame artist?
def pipes_from_frame(frame, size, radius): 
    pipes = []
    for axis in [frame.xaxis, frame.yaxis, frame.zaxis]:
        pipe = {}
        pipe['points'] = [list(frame.point), list(Point(*frame.point) + Vector(*axis) * size)]
        pipe['radius'] = radius
        pipes.append(pipe)
    return pipes

frame = Frame(plane.Origin, plane.XAxis, plane.YAxis)
pipes = pipes_from_frame(frame, pipe_size, pipe_radius)

G = xdraw_pipes(pipes, cap=1)
C = frame_colors
# ---------- end draw ----------
preview_3 = CustomPreview(Geometry=draw.G, Shader=draw.C)

py_6 = PythonScript(reload=reload)
# ---------- py_6: Python ----------
from compas_rhino.utilities.misc import get_tolerance
from compas_rhino.utilities.misc import unload_modules

from compas_ghpython import unload_modules
unload_modules("compas")
unload_modules("compas_fab")
unload_modules("roslibpy")
# ---------- end py_6 ----------
# Move point to find a good spot on the platform
reload_2 = Button()
panel_8 = Panel("assembly_courses.json")
py_7 = PythonScript(reload=reload_2)
# ---------- py_7: Python ----------
from compas_rhino.utilities.misc import get_tolerance
from compas_rhino.utilities.misc import unload_modules

from compas_ghpython import unload_modules
unload_modules("compas")
unload_modules("compas_fab")
unload_modules("compas_assembly")
unload_modules("roslibpy")
# ---------- end py_7 ----------
pt = Point(Point(-0.1897749476, -0.8719782354, 0.5159730315))
panel_9 = Panel("C:\Users\rustr\workspace\robotic_assembly_workshop\data")
python_3 = GhPythonScript(path="C:\Users\rustr\workspace\compas_assembly\data", name="wall.json", pt=pt)  # -> assembly, artist, P, K, M
# ---------- python_3: Python ----------
from __future__ import absolute_import
from __future__ import division
from __future__ import print_function

import os

from compas.geometry import Frame
from compas.geometry import Transformation
from compas.datastructures import mesh_transformed

from compas.datastructures import Network
from compas_assembly.datastructures import Assembly
from compas_assembly.datastructures import assembly_block_building_sequence
from compas_assembly.ghpython import AssemblyArtist
from compas_assembly.datastructures import assembly_transform

assembly = Assembly.from_json(os.path.join(path, name))

frame = Frame(list(pt), (1, 0, 0), (0, 1, 0))
T = Transformation.from_frame(frame)

assembly_transform(assembly, T)

K = []
for key, attr in assembly.vertices(True):
    K.append(key) 

# draw the assembly
artist = AssemblyArtist(assembly)
P = artist.draw_vertices()
M = artist.draw_blocks()

print(list(assembly.vertices_where({'is_placed': True})))
# ---------- end python_3 ----------
json = GhPythonScript(assembly=python_3.assembly, path=panel_9, name="01_wall_transformed.json")
# ---------- json: Python ----------
import os
assembly.to_json(os.path.join(path, name))
# ---------- end json ----------
tag = TextTag(Location=python_3.P, Text=python_3.K, Colour=ColourSwatch(SwatchColor=RGB(255, 255, 255)))
preview_4 = CustomPreview(Geometry=python_3.M, Material=ColourSwatch(SwatchColor=RGB(224, 158, 114)))
data = Data(panel_9)
python_4 = GhPythonScript(assembly=python_3.assembly)  # -> out, a
# ---------- python_4: Python ----------
buildable_keys = list(assembly.vertices_where({'is_buildable': False}))
print buildable_keys
# ---------- end python_4 ----------

# ----
# Info
info = PythonScript(robot=robot)  # -> out, planning_groups, main_group, base_frame, all_joint_names, main_joint_names
# ---------- info: Python ----------
from compas.robots import Joint

if robot:
    robot.info()
# ---------- end info ----------
panel_10 = Panel(info.out)

python_5 = GhPythonScript(assembly=python_3.assembly, artist=python_3.artist, key=Slider(33, range=0..100))  # -> placed_bricks, sequence, sequence_blocks, frames
# ---------- python_5: Python ----------
from compas.geometry import Frame
from compas_assembly.datastructures import assembly_block_building_sequence


placed = list(assembly.vertices_where({'is_placed': True}))

# draw filled in blocks for the placed ones
placed_bricks = artist.draw_blocks(keys=placed)

# get the sequence
sequence = assembly_block_building_sequence(assembly, key)
sequence = list(set(sequence) - set(placed))
# draw the blocks of the sequence

sequence_blocks = artist.draw_blocks(keys=sequence)

frames = []
for key in sequence:
    block = assembly.blocks[key]
    o, uvw = assembly_block_placing_frame(assembly, key)
    frames.append(Frame(o, uvw[1], uvw[0]))
# ---------- end python_5 ----------
python_6 = GhPythonScript(assembly=python_3.assembly, artist=python_3.artist, key=Slider(33, range=0..100))  # -> sequence, sequence_blocks, frames
# ---------- python_6: Python ----------
from compas.geometry import Frame
from compas_assembly.datastructures import assembly_block_placing_frame

sequence = [3, 2, 1, 0, 8, 7, 6, 5, 13, 12, 11, 18, 17, 16, 23, 22, 27, 28, 33]
sequence_blocks = artist.draw_blocks(keys=sequence)

frames = []
for key in sequence:
    block = assembly.blocks[key]
    o, uvw = assembly_block_placing_frame(assembly, key)
    frames.append(Frame(o, uvw[1], uvw[0]))
# ---------- end python_6 ----------
python_7 = GhPythonScript(path=data, name="02_wall_buildable.json")  # -> out, buildable_bricks
# ---------- python_7: Python ----------
import os

from compas_assembly.datastructures import Assembly
from compas_assembly.ghpython import AssemblyArtist

assembly = Assembly.from_json(os.path.join(path, name))

buildable_keys = list(assembly.vertices_where({'is_buildable': True}))
print buildable_keys

print list(assembly.vertices_where({'is_placed': True}))

# draw the assembly
artist = AssemblyArtist(assembly)

buildable_bricks = artist.draw_blocks(keys=buildable_keys)

block = assembly.blocks[1]
print(block)
# ---------- end python_7 ----------
draw_2 = FrameDraw(frame=python_5.frames, scale=0.001)  # -> G, C
# ---------- draw_2: Python ----------
from System.Drawing import Color
from compas.geometry import Frame, Point, Vector

from compas_ghpython.utilities import xdraw_frame
from compas_ghpython.utilities import xdraw_pipes

if not scale:
    scale = 1

pipe_size = 100 * scale
pipe_radius = 1 * scale

red = Color.FromArgb(255, 0, 0)
green = Color.FromArgb(0, 255, 0)
blue = Color.FromArgb(0, 0, 255)

frame_colors = [red, green, blue]

# TODO: move to frame artist?
def pipes_from_frame(frame, size, radius): 
    pipes = []
    for axis in [frame.xaxis, frame.yaxis, frame.zaxis]:
        pipe = {}
        pipe['points'] = [list(frame.point), list(Point(*frame.point) + Vector(*axis) * size)]
        pipe['radius'] = radius
        pipes.append(pipe)
    return pipes

pipes = pipes_from_frame(frame, pipe_size, pipe_radius)

G = xdraw_pipes(pipes, cap=1)
C = frame_colors
# ---------- end draw_2 ----------
panel_11 = Panel(python_5.sequence)
draw_3 = FrameDraw(frame=python_6.frames, scale=0.001)  # -> G, C; same code as draw_2
preview_5 = CustomPreview(Geometry=draw_2.G, Material=draw_2.C)
preview_6 = CustomPreview(Geometry=draw_3.G, Material=draw_3.C)
panel_12 = Panel(python_6.sequence)
picking_plane = Plane(Plane(origin=(1.926, 1.5, 1), x=(0, 1, 0), y=(1, 0, 0)))
draw_4 = PlaneDraw(plane=picking_plane, scale=0.001)  # -> G, C; same code as draw
preview_7 = CustomPreview(Geometry=draw_4.G, Shader=draw_4.C)
pt_2 = Point(Point(1.926, 1.5, 1.289463542))
pt_3 = Point(Point(7538.248534, 4140.514897, 2427.976895))
py_8 = PythonScript(pt=pt_2)  # -> pln
# ---------- py_8: Python ----------
import Rhino.Geometry as rg


pln = rg.Plane(pt, rg.Vector3d.YAxis, rg.Vector3d.XAxis)
print pln
# ---------- end py_8 ----------
yz = YZPlane(Origin=pt_3)

# ----
# Configuration
# Select planning group
groups_2 = ValueList({"axis_abb", "abb"}, selected="abb")

config = PythonScript(robot=robot)  # -> configuration
# ---------- config: Python ----------
from compas_fab.robots import Configuration
from compas.robots import Joint



joint_positions =  [-1.671, -1.156, 0.894, 0.629, 6.200, 0.068, 0.481]
joint_positions =  [-0.80000000000000004, -2.3577146526137094, 0.61261699874897113, 0.4117014649765619, -6.283185145532967, 0.54651397844518723, 5.496266815228529]
joint_positions =  [-0.5, -0.808, -0.263, 0.729, 6.277, 1.088, -5.506]
joint_positions =  [-1.8, -1.075, 0.534, 0.697, -6.225, 0.346, 6.739]



configuration = robot.joint_positions_to_configuration(joint_positions)

print configuration
print robot.get_base_frame("abb")
print robot.get_base_frame("axis_abb")
# ---------- end config ----------
forward_kinematics = PythonScript(
    robot=robot,
    cart=Slider(-1.926, range=-1.926..0.675),
    a1=Slider(0, range=-180..180),
    a2=Slider(0, range=-90..150),
    a3=Slider(0, range=-180..180),
    a4=Slider(0, range=-400..400),
    a5=Slider(0, range=-125..120),
    a6=Slider(0, range=-400..400))  # -> configuration
# ---------- forward_kinematics: Python ----------
import math
from compas_fab.robots import Configuration

if robot:
    
    types = robot.get_configurable_joint_types()
    print types
    joint_positions = [cart]
    joint_positions += [math.radians(a) for a in [a1, a2, a3, a4, a5, a6]]
    configuration = Configuration(joint_positions, types)
    print configuration
# ---------- end forward_kinematics ----------

take_current_configuration = BooleanToggle(False)

# ---- group: inverse kinematic
py_9 = PythonScript(robot=robot)  # -> configuration
# ---------- py_9: Python ----------
from compas_fab.robots import Configuration

configuration = robot.get_configuration()
configuration.values = [-1.8, -1.752, 0.607, 0.883, 2.761, 0.000, 0.000]

print configuration
# ---------- end py_9 ----------
plane = Plane(picking_plane)
ik = PythonScript(
    robot=robot,
    group=groups_2,
    start_configuration=py_9,
    take_current_configuration=take_current_configuration,
    plane=plane)  # -> out, configuration, error
# ---------- ik: Python ----------
import scriptcontext as sc
import Rhino

from compas.robots import Joint
from compas.geometry import Frame
from compas_fab.robots import Configuration

frame = Frame(plane.Origin, plane.XAxis, plane.YAxis)

if robot and robot.client:
    if robot.client.is_connected:
        if take_current_configuration:
            start_configuration = robot.get_configuration()
        response = robot.inverse_kinematics(frame_WCF=frame, 
                                            start_configuration=start_configuration, 
                                            group=group, 
                                            constraints=None, 
                                            attempts=20)
        configuration = response.configuration
        error = response.error_code.human_readable
    else:
        print("Robot is not connected")

print configuration
# ---------- end ik ----------
panel_13 = Panel(ik.out)
error = Panel(ik.error)

# ---- group: cartesian path
take_current_configuration_2 = BooleanToggle(False)
start_plane = Plane(picking_plane)
end_plane = Plane(py_5)
start_configuration = Data(ik.configuration)
attached_collision_object = Data(attached_co)
avoid_collisions = BooleanToggle(True)
py_10 = PythonScript(start_plane=start_plane, end_plane=end_plane)  # -> planes
# ---------- py_10: Python ----------
planes = [start_plane, end_plane]
print planes
# ---------- end py_10 ----------
compute = Button()
cartesian_path = PythonScript(
    robot=robot,
    group=groups_2,
    start_configuration=start_configuration,
    take_current_configuration=take_current_configuration_2,
    planes=py_10,
    max_step=Slider(0.01, range=0..0.01),
    avoid_collisions=avoid_collisions,
    attached_collision_object=attached_collision_object,
    compute=compute)  # -> out, response; inputs planes: list, avoid_collisions: Boolean
# ---------- cartesian_path: Python ----------
import logging
from scriptcontext import sticky as st

from compas.geometry import Frame

# store data in component
guid = str(ghenv.Component.InstanceGuid)
response_key = "response_" + guid

if response_key not in st:
    st[response_key] = None

# conversion necessary because GHPython component converts None into something like <type 'NoneType'>
if not attached_collision_object:
    attached_collision_object = None 
    
if robot and robot.client:
    if robot.client.is_connected:
        if start_configuration and compute:
            if take_current_configuration:
                start_configuration = robot.get_configuration()
            frames = [Frame(plane.Origin, plane.XAxis, plane.YAxis) for plane in planes]
            st[response_key] = robot.compute_cartesian_path(frames, 
                                                            start_configuration, 
                                                            float(max_step),
                                                            bool(avoid_collisions),
                                                            group,
                                                            attached_collision_object=attached_collision_object)
    else:
        print("Robot is not connected")
        st[response_key] = None
 
response = st[response_key]
# ---------- end cartesian_path ----------
vis = PythonScript(response=cartesian_path.response)  # -> P, V, A, time
# ---------- vis: Python ----------
from compas_ghpython import list_to_ghtree

if response:

    positions = []
    velocities = []
    accelerations = []
    time_from_start = []
    
    for p in response.solution.joint_trajectory.points:
        positions.append(p.positions)
        velocities.append(p.velocities)
        accelerations.append(p.accelerations)
        time_from_start.append(p.time_from_start.seconds())
    
    P = list_to_ghtree(list(zip(*positions)))
    V = list_to_ghtree(list(zip(*velocities)))
    A = list_to_ghtree(list(zip(*accelerations)))
    
    time = time_from_start[-1]
    print time
# ---------- end vis ----------
time_s = Panel(vis.time)
panel_14 = Panel(cartesian_path.out)
py_11 = PythonScript(response=cartesian_path.response)  # -> start_configuration, configurations, error, fraction
# ---------- py_11: Python ----------
from compas_fab.backends.ros import MoveItErrorCodes

joint_positions = []

if response:
    if response.error_code == MoveItErrorCodes.SUCCESS:
        configurations = response.configurations
        start_configuration = response.start_configuration
    error = response.error_code.human_readable
    fraction = response.fraction
# ---------- end py_11 ----------
error_2 = Panel(py_11.error)
fraction = Panel(py_11.fraction)
prismatic = QuickGraph(vis.P)
panel_15 = Panel("positions")
animate = PythonScript(
    robot=robot,
    group=groups_2,
    start_configuration=py_11.start_configuration,
    configurations=py_11.configurations,
    value=Slider(1, range=0..1))  # -> configuration; inputs configurations: list
# ---------- animate: Python ----------
from compas_fab.utilities import map_range
from compas_fab.robots import Configuration

count = len(configurations)
if count and robot and configurations != [None]:
    idx = int(map_range(value, 0, 1, 0, count - 1))
    current_configuration = configurations[idx]
    #make full configuration
    configuration = robot.merge_group_with_full_configuration(current_configuration, start_configuration, group)
else:
    configuration = robot.init_configuration()

print configuration
# ---------- end animate ----------
graph = QuickGraph(vis.V)
graph_2 = QuickGraph(vis.A)
panel_16 = Panel("velocities")
panel_17 = Panel("accelerations")

# ---- group: kinematic path
start_configuration_2 = Data(ik.configuration)
take_current_configuration_3 = BooleanToggle(False)
goal_plane = Plane(py_5)
attached_collision_object_2 = Data(attached_co)
compute_2 = Button()
kinematic_path = PythonScript(
    robot=robot,
    group=groups_2,
    start_configuration=start_configuration_2,
    take_current_configuration=take_current_configuration_3,
    goal_plane=goal_plane,
    tolerance_position=Slider(0.01, range=0..0.01),
    tolerance_angle_deg=Slider(5, range=0..180),
    attached_collision_object=attached_collision_object_2,
    compute=compute_2)  # -> out, response
# ---------- kinematic_path: Python ----------
from scriptcontext import sticky as st
import math
from compas.geometry import Frame
from compas_fab.robots import Configuration

# store data in component
guid = str(ghenv.Component.InstanceGuid)
response_key = "response_" + guid

if response_key not in st:
    st[response_key] = None

data = dict(requesting_solution=False)
frame = Frame(goal_plane.Origin, goal_plane.XAxis, goal_plane.YAxis)

# conversion necessary because GHPython component converts None into something like <type 'NoneType'>
if not attached_collision_object:
    attached_collision_object = None 

if take_current_configuration:
    start_configuration = robot.get_configuration()

if robot and robot.client and robot.client.is_connected and start_configuration and compute:
    tolerance_angle = math.radians(tolerance_angle_deg)
    st[response_key] = robot.motion_plan_goal_frame(frame, 
                                                    start_configuration, 
                                                    float(tolerance_position), 
                                                    tolerance_angle, 
                                                    group, 
                                                    path_constraints=None, 
                                                    trajectory_constraints=None, 
                                                    planner_id='RRT',
                                                    num_planning_attempts=10,
                                                    allowed_planning_time=5.,
                                                    attached_collision_object=attached_collision_object)

response = st[response_key]
# ---------- end kinematic_path ----------
vis_2 = PythonScript(response=kinematic_path.response)  # -> P, V, A, time
# ---------- vis_2: Python ----------
from compas_ghpython import list_to_ghtree

if response:

    positions = []
    velocities = []
    accelerations = []
    time_from_start = []
    
    for p in response.trajectory.joint_trajectory.points:
        positions.append(p.positions)
        velocities.append(p.velocities)
        accelerations.append(p.accelerations)
        time_from_start.append(p.time_from_start.seconds())
    
    P = list_to_ghtree(list(zip(*positions)))
    V = list_to_ghtree(list(zip(*velocities)))
    A = list_to_ghtree(list(zip(*accelerations)))
    
    time = time_from_start[-1]
    print time
# ---------- end vis_2 ----------
time_s_2 = Panel(vis_2.time)
panel_18 = Panel(kinematic_path.out)
py_12 = PythonScript(robot=robot, group=groups_2, response=kinematic_path.response)  # -> start_configuration, configurations, error
# ---------- py_12: Python ----------
from compas_fab.backends.ros import MoveItErrorCodes
from compas_fab.robots import Configuration
joint_positions = []

if response:
    if response.error_code == MoveItErrorCodes.SUCCESS:
        print response.trajectory_start
        print response.planning_time
        
        configurations = response.configurations
        start_configuration = response.start_configuration
    error = response.error_code.human_readable




print start_configuration
# ---------- end py_12 ----------
error_3 = Panel(py_12.error)
prismatic_2 = QuickGraph(vis_2.P)
animate_2 = PythonScript(
    robot=robot,
    group=groups_2,
    start_configuration=py_12.start_configuration,
    configurations=py_12.configurations,
    value=Slider(1, range=0..1))  # -> configuration; inputs configurations: list; same code as animate
graph_3 = QuickGraph(vis_2.V)
graph_4 = QuickGraph(vis_2.A)

# ----
unsubscribe = Button()
# Execution
subscribe = Button()
joint_states = PythonScript(robot=robot, sub=subscribe, unsub=unsubscribe)
# ---------- joint_states: Python ----------
import roslibpy
import scriptcontext as sc

key = 'topic_%s' % str(ghenv.Component.InstanceGuid)
previous_topic = sc.sticky.get(key, None)

# Interval in ms between messages
THROTTLE_RATE = 50

if sub:
    if robot.client.is_connected:
        if previous_topic:
            previous_topic.unsubscribe()

        def received_joint_states(message):
            sc.sticky['joint_states'] = message
    
        topic = roslibpy.Topic(robot.client, '/joint_states', 'sensor_msgs/JointState', throttle_rate=THROTTLE_RATE)
        topic.subscribe(received_joint_states)
    
        sc.sticky[key] = topic
        print('Subscribed')
    else:
        print('ROS client not connected')

if unsub:
    if 'joint_states' in sc.sticky:
        del sc.sticky['joint_states']
    if previous_topic:
        previous_topic.unsubscribe()
# ---------- end joint_states ----------
value_list = ValueList({"0 cartesian path": 0, "1 kinematic path": 1}, selected="1 kinematic path")
filter = StreamFilter(Gate=value_list, Stream0=cartesian_path.response, Stream1=kinematic_path.response)
refresh_hz = Slider(2, range=0..30)
execute = Button()
cancel = Button()
check = Button()
current = PythonScript(robot=robot, rate=refresh_hz)  # -> configuration
# ---------- current: Python ----------
import scriptcontext as sc
from compas_fab.robots import Configuration
from compas_ghpython import update_component

values = []
types = []

if 'joint_states' in sc.sticky:
    joint_states = sc.sticky['joint_states']
    joint_states = dict(zip(joint_states['name'], joint_states['position']))

    for joint in robot.get_configurable_joints():
        values.append(joint_states[joint.name])
        types.append(joint.type)
    
    configuration = Configuration(values, types)
    print(configuration)

data_coming_in = robot.client.is_connected and 'joint_states' in sc.sticky

slow_interval = 2000
if rate != 0:
    refresh_interval = (1. / rate) * 1000
else:
    refresh_interval = slow_interval
interval = refresh_interval if data_coming_in else slow_interval

update_component(ghenv, interval)
print('Interval: %dms' % interval)
# ---------- end current ----------
trajectory = PythonScript(robot=robot, response=filter, execute=execute, check=check, cancel=cancel)  # -> status
# ---------- trajectory: Python ----------
import time
import datetime

import roslibpy

import scriptcontext as sc

key = 'trajectory_%s' % str(ghenv.Component.InstanceGuid)
sent_trajectory = sc.sticky.get(key, None)

points = []
joint_trajectory = response.trajectory.joint_trajectory if response else None

if robot and robot.client.is_connected:
    if execute:
        sc.sticky[key] = dict(started_at=time.time(), trajectory=joint_trajectory, state='EXECUTING')

        def completion(result):
            if key in sc.sticky:
                if sc.sticky[key]['state'] == 'EXECUTING':
                    sc.sticky[key]['state'] = 'SUCCESSFUL'
                sc.sticky[key]['completed_at'] = time.time()
                del sc.sticky[key]['cancellable']

        def failure(e):
            if key in sc.sticky:
                sc.sticky[key]['state'] = 'ERROR'
                sc.sticky[key]['completed_at'] = time.time()
                sc.sticky[key]['exception'] = e

        print('Executing trajectory of %d points' % len(points))
        cancellable = robot.client.follow_joint_trajectory(joint_trajectory, completion, failure)
        sc.sticky[key]['cancellable'] = cancellable

    if cancel and 'cancellable' in sc.sticky[key]:
        sc.sticky[key]['state'] = 'CANCELLED'
        sc.sticky[key]['cancellable'].cancel()
        
else:
    status = 'NOT CONNECTED'
    
started_at = sc.sticky[key].get('started_at', 'n/a')
completed_at = sc.sticky[key].get('completed_at', 'n/a')
exception = sc.sticky[key].get('exception', '')
execution_state = sc.sticky[key].get('state', '')

if started_at != 'n/a':
    started_at = datetime.datetime.fromtimestamp(started_at).strftime('%H:%M:%S')
if completed_at != 'n/a':
    completed_at = datetime.datetime.fromtimestamp(completed_at).strftime('%H:%M:%S')
if exception:
    exception = 'Found an exception during execution: ' + str(exception)

if not joint_trajectory:
    status = 'No trajectory available'
else:
    status = """execution state: {}
started at: {}
completed at: {}
trajectory of {} points\n{}""".format(execution_state,
                                      started_at,
                                      completed_at,
                                      len(points),
                                      exception)

print(status)
# ---------- end trajectory ----------
status = Panel(trajectory)

# ---- group: inverse kinematic / forward kinematics
fk = PythonScript(robot=robot, group=groups_2, configuration=ik.configuration)  # -> out, frame_WCF, error
# ---------- fk: Python ----------
import scriptcontext as sc
import Rhino

from compas_fab.robots import Configuration

if robot and robot.client and configuration:
    if robot.client.is_connected:
        response = robot.forward_kinematics(configuration, group)
        frame_WCF = response.frame_WCF
        error = response.error_code.human_readable
    else:
        print("Robot is not connected")
        frame_WCF = None
    
print frame_WCF
# ---------- end fk ----------
error_4 = Panel(fk.error)
panel_22 = Panel(fk.out)

# ----
# Visualisation
# Select configuration input: from fk, ik, cartesian, or kinematic path
list_4 = ValueList({"0 forward_kinematics": 0, "1 forward_kinematics": 1, "2 inverse_kinematics": 2, "3 cartesian path": 3, "4 kinematic path": 4, "5 connected robot": 5}, selected="3 cartesian path")
filter_2 = StreamFilter(
    Gate=list_4,
    Stream0=config,
    Stream1=forward_kinematics,
    Stream2=ik.configuration,
    Stream3=animate,
    Stream4=animate_2,
    Stream5=current)
show_end_effector_frame = BooleanToggle(True)
show_base_frame = BooleanToggle(False)
show_collision = BooleanToggle(False)
show_visual = BooleanToggle(True)
show_axes = BooleanToggle(False)
visualize = PythonScript(
    robot=robot,
    configuration=filter_2,
    show_visual=show_visual,
    show_collision=show_collision,
    show_axes=show_axes,
    show_base_frame=show_base_frame,
    show_end_effector_frame=show_end_effector_frame)  # -> out, visual, collision, axes, axes_color, ee_plane, ee_frame, ee_frame_geo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
# ---------- visualize: Python ----------
from System.Drawing import Color

from compas.geometry import Vector
from compas.geometry import Point
from compas_ghpython.utilities import xdraw_frame
from compas_ghpython.utilities import xdraw_pipes

from compas_fab.robots import Configuration

red = Color.FromArgb(255, 0, 0)
green = Color.FromArgb(0, 255, 0)
blue = Color.FromArgb(0, 0, 255)

frame_colors = [red, green, blue]

# TODO: move to frame artist?
def pipes_from_frame(frame, size, radius): 
    pipes = []
    for axis in [frame.xaxis, frame.yaxis, frame.zaxis]:
        pipe = {}
        pipe['points'] = [list(frame.point), list(Point(*frame.point) + Vector(*axis) * size)]
        pipe['radius'] = radius
        pipes.append(pipe)
    return pipes

if robot and configuration:
    
    pipe_size = 0.1 * robot.scale_factor
    pipe_radius = 0.001 * robot.scale_factor
    
    robot.update(configuration, collision=show_collision)
    
    print("Configuration:")
    print(configuration.values)
    
    if show_visual:
        visual = robot.draw_visual()
        
    if show_collision:
        collision = robot.draw_collision()
    
    if show_axes:
        pipes = []
        axes_color = []
        for frame in robot.frames:
            pipes += pipes_from_frame(frame, pipe_size, pipe_radius)
            axes_color += frame_colors
        axes = xdraw_pipes(pipes, cap=1)
    
    ee_frame = robot.get_end_effector_frame()
    ee_plane = xdraw_frame(ee_frame)
    
    print("End-effector frame:")
    print(ee_frame)
    
    if show_end_effector_frame:
        ee_pipes = pipes_from_frame(ee_frame, pipe_size, pipe_radius)
        ee_frame_geo = xdraw_pipes(ee_pipes, cap=1)
        ee_frame_color = frame_colors
        
    base_frame = robot.get_base_frame()
    base_plane = xdraw_frame(base_frame)
    
    if show_base_frame:
        base_pipes = pipes_from_frame(base_frame, pipe_size, pipe_radius)
        base_frame_geo = xdraw_pipes(base_pipes, cap=1)
        base_frame_color = frame_colors
        

print robot.frames
# ---------- end visualize ----------
preview_8 = CustomPreview(Geometry=visualize.axes, Shader=visualize.axes_color)
geo = Geometry(visualize.collision)
geo_2 = Geometry(visualize.visual)
preview_9 = CustomPreview(Geometry=visualize.ee_frame_geo, Shader=visualize.ee_frame_color)
preview_10 = CustomPreview(Geometry=visualize.base_frame_geo, Shader=visualize.base_frame_color)
preview_11 = CustomPreview(Geometry=geo_2, Shader=ColourSwatch(SwatchColor=RGB(125, 125, 125)))
panel_23 = Panel(visualize.out)
